% Simulink data dictionary SEALGenericTypes_1.sldd

SEALVerControl_T = Simulink.Bus()
  Version: uint16  % SEAL database version
  SubVersion: uint16  % SEAL database sub version
  UserData: uint32  % SEAL database support data

SEALVerControl_init = Simulink.Parameter(struct(Version=1, SubVersion=1, UserData=0), StorageClass="ExportedGlobal", DataType="Bus: SEALVerControl_T")
G_SEALVerControl = Simulink.Signal(StorageClass="ExportedGlobal", DataType="Bus: SEALVerControl_T")

UartCyclicBuf_T = Simulink.Bus()
  PutCounter: uint16  % The place in the UARTQueue where next character is to be put
  FetchCounter: uint16  % The location in the UARTQueue of the next character to read
  UartError: uint16  % UART error
  TxFetchCounter: uint16  % The location in the TX UARTQueue of the next character to read
  UARTQueue: uint16[1 256]  % Software Queue for incoming UART characters

G_pUartCyclicBuf_in = Simulink.Signal(StorageClass="ImportedExternPointer", DataType="Bus: UartCyclicBuf_T")
G_pUartCyclicBuf_out = Simulink.Signal(StorageClass="ImportedExternPointer", DataType="Bus: UartCyclicBuf_T")

MicroInterp_T = Simulink.Bus()
  IsGetFunc: uint16  % 1 if this is a get function
  TempString: uint16[1 64]  % Temporary string to hold characters extracted from the cyclical buffer
  InterpretError: uint16  % String formatting error
  cnt: uint16  % In string counter
  Argument: double  % Argument of a set function
  State: uint16  % State of the interpreting process
  NewString: uint16  % Indicate a new string is available
  MnemonicIndex: uint16  % Mnemonic index
  ArrayIndex: uint16  % Array index

G_MicroInterp = Simulink.Signal(StorageClass="ImportedExtern", DataType="Bus: MicroInterp_T")

CANCyclicBuf_T = Simulink.Bus()
  PutCounter: uint16  % The place in the CANQueue where the next message is to be put
  FetchCounter: uint16  % The location in the CANQueue of the next message to read
  CANError: uint16  % CAN error
  CANQueue: uint32[128 1]  % Software Queue for incoming CAN messages
  TxFetchCounter: uint16  % The location in the CANQueue of the next message to transmit
  CANID: uint32[64 1]  % Can ID, 11 or 29bit
  DLenAndAttrib: uint16[64 1]  % Data length and attributes

G_pCANCyclicBuf_in = Simulink.Signal(StorageClass="ImportedExternPointer", DataType="Bus: CANCyclicBuf_T")
G_pCANCyclicBuf_out = Simulink.Signal(StorageClass="ImportedExternPointer", DataType="Bus: CANCyclicBuf_T")

CANMessage_T = Simulink.Bus()
  CANID: uint32  % ID of the CAN message
  DataLen: uint16  % Data length of the CAN message
  MsgData: uint32[1 2]  % Data for incoming CAN messages
  CANTxCnt: uint16  % Number TX requests including this message

CANMessage_Init = Simulink.Parameter(struct(CANID=0, DataLen=0, MsgData=[0 0], CANTxCnt=0), StorageClass="ExportedGlobal", DataType="Bus: CANMessage_T")

SetupReportBuf_T = Simulink.Bus()
  Index: uint32
  Type: uint8[1 32]
  Voltage: single
  ContinuousCurrent: single
  PeakCurrent: single
  SpeedLimit: single
  MotorPhases: uint32
  HallSensors: boolean
  NumberOfEncoders: uint32
  Encoders: Bus: EncodersBus[1 2]

G_SetupReportBuf = Simulink.Signal(StorageClass="ImportedExtern", DataType="Bus: SetupReportBuf_T")

SetupReportBuf_init = Simulink.Parameter([struct(
  Index=uint32(0),
  Type="70 83 73 83 108 97 118 101 0 0 0 0 0 0 0 0 0 0 0 0 0 0 0 0 0 0 0 0 0 0 0 0",
  Voltage=single(100),
  ContinuousCurrent=single(10),
  PeakCurrent=single(20),
  SpeedLimit=single(20),
  MotorPhases=uint32(3),
  HallSensors=true,
  NumberOfEncoders=uint32(2),
  Encoders=[struct(
    Type="69 66 73 83 83 0 0 0 0 0 0 0 0 0 0 0 0 0 0 0 0 0 0 0 0 0 0 0 0 0 0 0",
    Location="77 111 116 111 114 0 0 0 0 0 0 0 0 0 0 0 0 0 0 0 0 0 0 0 0 0 0 0 0 0 0 0",
    ModuloCount=uint32(4096),
    MutiTurn=false,
    Gear2Load=uint32(100),
    LowLimits=int64(-9007199254740991),
    HighLimit=int64(9007199254740991)), struct(
    Type="69 66 73 83 83 0 0 0 0 0 0 0 0 0 0 0 0 0 0 0 0 0 0 0 0 0 0 0 0 0 0 0",
    Location="76 111 97 100 0 0 0 0 0 0 0 0 0 0 0 0 0 0 0 0 0 0 0 0 0 0 0 0 0 0 0 0",
    ModuloCount=uint32(1048576),
    MutiTurn=false,
    Gear2Load=uint32(1),
    LowLimits=int64(-9007199254740991),
    HighLimit=int64(9007199254740991))]), struct(
  Index=uint32(1),
  Type="70 83 73 83 108 97 118 101 0 0 0 0 0 0 0 0 0 0 0 0 0 0 0 0 0 0 0 0 0 0 0 0",
  Voltage=single(100),
  ContinuousCurrent=single(10),
  PeakCurrent=single(20),
  SpeedLimit=single(20),
  MotorPhases=uint32(3),
  HallSensors=true,
  NumberOfEncoders=uint32(2),
  Encoders=[struct(
    Type="69 66 73 83 83 0 0 0 0 0 0 0 0 0 0 0 0 0 0 0 0 0 0 0 0 0 0 0 0 0 0 0",
    Location="77 111 116 111 114 0 0 0 0 0 0 0 0 0 0 0 0 0 0 0 0 0 0 0 0 0 0 0 0 0 0 0",
    ModuloCount=uint32(4096),
    MutiTurn=false,
    Gear2Load=uint32(100),
    LowLimits=int64(-9007199254740991),
    HighLimit=int64(9007199254740991)), struct(
    Type="69 66 73 83 83 0 0 0 0 0 0 0 0 0 0 0 0 0 0 0 0 0 0 0 0 0 0 0 0 0 0 0",
    Location="76 111 97 100 0 0 0 0 0 0 0 0 0 0 0 0 0 0 0 0 0 0 0 0 0 0 0 0 0 0 0 0",
    ModuloCount=uint32(1048576),
    MutiTurn=false,
    Gear2Load=uint32(1),
    LowLimits=int64(-9007199254740991),
    HighLimit=int64(9007199254740991))]), struct(
  Index=uint32(2),
  Type="70 83 73 83 108 97 118 101 0 0 0 0 0 0 0 0 0 0 0 0 0 0 0 0 0 0 0 0 0 0 0 0",
  Voltage=single(100),
  ContinuousCurrent=single(10),
  PeakCurrent=single(20),
  SpeedLimit=single(20),
  MotorPhases=uint32(3),
  HallSensors=true,
  NumberOfEncoders=uint32(2),
  Encoders=[struct(
    Type="69 66 73 83 83 0 0 0 0 0 0 0 0 0 0 0 0 0 0 0 0 0 0 0 0 0 0 0 0 0 0 0",
    Location="77 111 116 111 114 0 0 0 0 0 0 0 0 0 0 0 0 0 0 0 0 0 0 0 0 0 0 0 0 0 0 0",
    ModuloCount=uint32(4096),
    MutiTurn=false,
    Gear2Load=uint32(100),
    LowLimits=int64(-9007199254740991),
    HighLimit=int64(9007199254740991)), struct(
    Type="69 66 73 83 83 0 0 0 0 0 0 0 0 0 0 0 0 0 0 0 0 0 0 0 0 0 0 0 0 0 0 0",
    Location="76 111 97 100 0 0 0 0 0 0 0 0 0 0 0 0 0 0 0 0 0 0 0 0 0 0 0 0 0 0 0 0",
    ModuloCount=uint32(1048576),
    MutiTurn=false,
    Gear2Load=uint32(1),
    LowLimits=int64(-9007199254740991),
    HighLimit=int64(9007199254740991))]), struct(
  Index=uint32(3),
  Type="70 83 73 83 108 97 118 101 0 0 0 0 0 0 0 0 0 0 0 0 0 0 0 0 0 0 0 0 0 0 0 0",
  Voltage=single(100),
  ContinuousCurrent=single(10),
  PeakCurrent=single(20),
  SpeedLimit=single(20),
  MotorPhases=uint32(3),
  HallSensors=true,
  NumberOfEncoders=uint32(2),
  Encoders=[struct(
    Type="69 66 73 83 83 0 0 0 0 0 0 0 0 0 0 0 0 0 0 0 0 0 0 0 0 0 0 0 0 0 0 0",
    Location="77 111 116 111 114 0 0 0 0 0 0 0 0 0 0 0 0 0 0 0 0 0 0 0 0 0 0 0 0 0 0 0",
    ModuloCount=uint32(4096),
    MutiTurn=false,
    Gear2Load=uint32(100),
    LowLimits=int64(-9007199254740991),
    HighLimit=int64(9007199254740991)), struct(
    Type="69 66 73 83 83 0 0 0 0 0 0 0 0 0 0 0 0 0 0 0 0 0 0 0 0 0 0 0 0 0 0 0",
    Location="76 111 97 100 0 0 0 0 0 0 0 0 0 0 0 0 0 0 0 0 0 0 0 0 0 0 0 0 0 0 0 0",
    ModuloCount=uint32(1048576),
    MutiTurn=false,
    Gear2Load=uint32(1),
    LowLimits=int64(-9007199254740991),
    HighLimit=int64(9007199254740991))])], StorageClass="ExportedGlobal", DataType="Bus: SetupReportBuf_T")

DrvCommandBuf_T = Simulink.Bus()
  PositionCommand: double  % Command to position controller
  SpeedCommand: double  % Command to speed controller
  CurrentCommand: double  % Command to current controller
  LoopConfiguration: int16  % Control loop configuration: see enumerated type VarFeedbackMode
  ReferenceMode: int16  % ReferenceMode: see enumerated type VarReferenceModes
  MotorOn: int16  % Motor on request
  FailureReset: int16  % Failure Reset Request
  bSetSealControl: int16  % Oblige the drive from SEAL control
  bControlUART: int16  % Flag that the SEAL uses the UART and the drive should not interpret UART communication
  Spare_10: int16  % Spare : 10
  Spare_11: int16  % Spare : 11
  Spare_12: int16  % Spare : 12
  Spare_13: int16  % Spare : 13
  Spare_14: int16  % Spare : 14
  Spare_15: int16  % Spare : 15
  Spare_16: int16  % Spare : 16
  Spare_17: int16  % Spare : 17
  Spare_18: int16  % Spare : 18
  Spare_19: int16  % Spare : 19
  Spare_20: int16  % Spare : 20
  Spare_21: int16  % Spare : 21
  Spare_22: int16  % Spare : 22
  Spare_23: int16  % Spare : 23
  Spare_24: int16  % Spare : 24

G_DrvCommandBuf = Simulink.Signal(StorageClass="ImportedExtern", DataType="Bus: DrvCommandBuf_T")

FeedbackBuf_T = Simulink.Bus()
  SystemTime: double  % Time counted from process start
  EncoderMain: int32  % The main encoder sensor
  EncoderSecondary: int32  % The secondary encoder sensor
  EncoderMainSpeed: single  % Speed of main encoder sensor
  EncoderSecondarySpeed: single  % Speed of secondary encoder sensor
  Iq: single  % Q-channel current Amp
  Id: single  % Q-channel current Amp
  Spare_8: int16  % Spare : 8
  DcBusVoltage: single  % DC bus voltage V
  PowerStageTemperature: single  % Power stage temperature C
  FieldAngle: single  % Motor electrical field angle
  ErrorCode: uint32  % Motor failure report
  LoopConfiguration: int16  % Control loop configuration
  ReferenceMode: int16  % ReferenceMode
  MotorOn: int16  % Motor on report
  HallCode: int16  % Code of Hall sensors
  STODisable: int16  % 1 if disabled by STO
  StatusBitField: int16  % Status bit field
  ConfirmRelinquishControl: int16  % Confirm Release the drive from SEAL control
  ProfiledPositionCommand: double  % Drive-sourecd Command to position controller
  ProfiledSpeedCommand: double  % Drive sources Command to speed controller
  ProfiledTorqueCommand: double  % Drive sources Command to current controller
  Spare_23: int16  % Spare : 23
  Spare_24: int16  % Spare : 24

G_FeedbackBuf = Simulink.Signal(StorageClass="ImportedExtern", DataType="Bus: FeedbackBuf_T")

Drv_FeedbackBuf_T_init = struct(
  SystemTime=0,
  EncoderMain=int32(0),
  EncoderSecondary=int32(0),
  EncoderMainSpeed=single(0),
  EncoderSecondarySpeed=single(0),
  Iq=single(0),
  Id=single(0),
  Spare_8=int16(0),
  DcBusVoltage=single(0),
  PowerStageTemperature=single(0),
  FieldAngle=single(0),
  ErrorCode=uint32(0),
  LoopConfiguration=int16(0),
  ReferenceMode=int16(0),
  MotorOn=int16(0),
  HallCode=int16(0),
  STODisable=int16(0),
  StatusBitField=int16(0),
  ConfirmRelinquishControl=int16(0),
  ProfiledPositionCommand=0,
  ProfiledSpeedCommand=0,
  ProfiledTorqueCommand=0,
  Spare_23=int16(0),
  Spare_24=int16(0))

VarReferenceModes = enum(StorageType="uint16")
  T_StayInPlace = 0  % Reference values do not change, or come to complete stop ASAP
  T_ProfiledSpeed = 1  % Converge a desired speed. Position commands if applicable are automated to match the speed
  T_ProfiledPosition = 2  % Converge to a desired position subject to speed and current limits
  T_Continuous = 3  % Reference values are continuously calculated by SEAL
  T_InDriveProfiler = 4  % Reference is generated internally by the drive

VarFeedbackMode = enum(StorageType="uint16")
  T_Current = 0  % Current (torque) control only
  T_Speed = 1  % Speed control, cascaded over current control
  T_Position = 2  % Position control cascaded over Speed control, cascaded over current control

VarDataTypes = enum(StorageType="uint16")
  T_int32 = 0  % long
  T_single = 2  % float
  T_int16 = 4  % short
  T_uint32 = 8  % unsigned long
  T_uint16 = 12  % unsigned short
  T_double = 16  % double